# Grasshopper definition voronoi.ghx (Grasshopper 1.0.7)

# ---- group: RH_IN:Size
number_slider = Slider(100, range=10..100)

# ----
pt = ConstructPoint(XCoordinate=0, YCoordinate=0, ZCoordinate=0)
num = Number(number_slider)
rectangle = Rectangle(Plane=pt, XSize=num, YSize=num, Radius=0)  # -> Rectangle, Length
pop2d = Populate2D(Region=rectangle.Rectangle, Count=Slider(50, range=0..100), Seed=1)
crv_cp = CurveClosestPoint(Point=pop2d, Curve=rectangle.Rectangle)  # -> Point, Parameter, Distance
voronoi = Voronoi(Points=pop2d, Boundary=rectangle.Rectangle, BruteForceOverride=False)
bnd = Bounds(Numbers=flatten(crv_cp.Distance))
dom = ConstructDomain(DomainStart=Slider(41.7, range=0..100), DomainEnd=Slider(9.5, range=0..100))
boundary = BoundarySurfaces(Edges=voronoi)
remap = RemapNumbers(Value=crv_cp.Distance, Source=bnd, Target=dom)  # -> Mapped, Clipped
mesh = Mesh(boundary)
Z = UnitZ(Factor=remap.Mapped)
extr = Extrude(Base=voronoi, Direction=Z)
mesh_2 = Mesh(extr)
move = Move(Geometry=mesh, Motion=Z)  # -> Geometry, Transform
merge = Merge(Data1=mesh_2, Data2=move.Geometry)
mjoin = MeshJoin(Meshes=merge)

# ---- group: RH_OUT:Geo
geo = Geometry(mjoin)

# ----
preview = CustomPreview(
    Geometry=geo,
    Material={diffuse=RGB(221, 160, 221), emission=RGB(66, 48, 66), shine=0.5, specular=RGB(255, 255, 255), transparency=0})
